# Grasshopper definition Bending_gridshell.gh (Grasshopper 1.0.7)
# plug-ins: Kangaroo2 Components

mesh = Mesh(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)
medges = MeshEdges(Mesh=mesh)  # -> NakedEdges, InteriorEdges, NonManifoldEdges
demesh = DeconstructMesh(Mesh=mesh)  # -> Vertices, Faces, Colours, Normals
Z = UnitZ(Factor=0.001)
crv = Curve(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)
pt = Point([Point(5, 17, 0), Point(6, 18, 0), Point(7, 19, 0), Point(8, 20, 0), Point(22, 20, 0), Point(23, 19, 0), Point(24, 18, 0), Point(25, 17, 0), Point(25, 8, 0), Point(24, 7, 0), Point(23, 6, 0), Point(22, 5, 0), Point(8, 5, 0), Point(7, 6, 0), Point(6, 7, 0), Point(5, 8, 0)])
load = Load(Point=demesh.Vertices, ForceVector=Z)
oncurve = OnCurve(Points=pt, Curve=crv, Strength=1)
warpweft = WarpWeft(Mesh=mesh)  # -> Warp, Weft, NakedA, NakedB
line = Line([medges.NakedEdges, medges.InteriorEdges])
join = JoinCurves(Curves=warpweft.Weft, Preserve=False)
join_2 = JoinCurves(Curves=warpweft.Warp, Preserve=False)
length_line = LengthLine(Line=line, Strength=Slider(10, range=10..1000))
explode = Explode(Curve=join, Recursive=True)  # -> Segments, Vertices
explode_2 = Explode(Curve=join_2, Recursive=True)  # -> Segments, Vertices
shift = ShiftList(List=explode.Segments, Shift=1, Wrap=False)
shift_2 = ShiftList(List=explode_2.Segments, Shift=1, Wrap=False)
short = ShortestList(ListA=explode.Segments, ListB=shift, TrimMode=2)  # -> ListA, ListB
short_2 = ShortestList(ListA=explode_2.Segments, ListB=shift_2, TrimMode=2)  # -> ListA, ListB

reset = Button()  # disabled
on = BooleanToggle(True)  # disabled

angle = Angle(LineA=short.ListA, LineB=short.ListB, Strength=1)
angle_2 = Angle(LineA=short_2.ListA, LineB=short_2.ListB, Strength=1)
solver = Solver(Reset=reset, Threshold=1e-15, Tolerance=0.01, On=on)  # -> I, V, O; disabled
iterations = GetNumber(Slider(1000, range=0..1000), AtLeast=1, AtMost=1, Maximum=1.797693135e+308, Minimum=-1.797693135e+308, TreeAccess=False)
crv_2 = Curve(solver.O)  # disabled
entwine = Entwine(Branch00=length_line, Branch01=[angle_2, angle, load, oncurve], FlattenInputs=True)
zombiesolver = ZombieSolver(GoalObjects=entwine, Threshold=1e-10, Tolerance=0.01, MaxIterations=iterations)  # -> I, V, O
unflatten = UnflattenTree(Tree=zombiesolver.O, Guide=entwine)
bang = ExplodeTree(Data=unflatten)  # -> Branch0, Branch1
crv_3 = Curve(bang.Branch0)
context_bake = ContextBake(Geometry=crv_3)
