# Grasshopper definition QuadPanelAperture.gh (Grasshopper 1.0.7)

number_slider = Slider(-10, range=-100..100)
size = Slider(5, range=0..10)
fillet = Slider(1.021, range=0..9)
chamfer = Slider(0.173, range=0..1)
scale = Slider(22.477, range=0..100)
attr_point = GetPoint(AtLeast=1, AtMost=1, Realtime=True, TreeAccess=False)
size_2 = GetNumber(size, AtLeast=1, AtMost=1, Maximum=1.797693135e+308, Minimum=-1.797693135e+308, TreeAccess=False)
fillet_2 = GetNumber(fillet, AtLeast=1, AtMost=1, Maximum=1.797693135e+308, Minimum=-1.797693135e+308, TreeAccess=False)
chamfer_2 = GetNumber(chamfer, AtLeast=1, AtMost=1, Maximum=1.797693135e+308, Minimum=-1.797693135e+308, TreeAccess=False)
num_x = GetInteger(Slider(12, range=0..20), AtLeast=1, AtMost=1, Maximum=2147483647, Minimum=-2147483648, TreeAccess=False)
num_y = GetInteger(Slider(10, range=0..20), AtLeast=1, AtMost=1, Maximum=2147483647, Minimum=-2147483648, TreeAccess=False)
falloff = GetNumber(scale, AtLeast=1, AtMost=1, Maximum=1.797693135e+308, Minimum=-1.797693135e+308, TreeAccess=False)
pt = ConstructPoint(XCoordinate=number_slider, YCoordinate=number_slider, ZCoordinate=0)
c_script = CSharpScript(pt=pt, size=size_2)  # -> out, A, B, C, D; inputs pt: Point3d, size: Double
# ---------- c_script: C# ----------
    A = new Point3d(pt.X + size, pt.Y - size, 0.0);
    B = new Point3d(pt.X + size, pt.Y + size, 0.0);
    C = new Point3d(pt.X - size, pt.Y + size, 0.0);
    D = new Point3d(pt.X - size, pt.Y - size, 0.0);
# ---------- end c_script ----------
recgrid = Rectangular(Plane=PlaneXY(0, 0, 0), SizeX=expr("x*2", size_2), SizeY=expr("x*2", size_2), ExtentX=num_x, ExtentY=num_y)  # -> flatten(Cells), Points
pt_2 = Point([c_script.A, c_script.B, c_script.C, c_script.D])
shift = ShiftList(List=pt_2, Shift=-1, Wrap=True)  # -> simplify(List)
dup = DuplicateData(Data=pt, Number=4, Order=True)
area = Area(Geometry=recgrid.Cells)  # -> Area, Centroid
ln = Line(StartPoint=pt_2, EndPoint=pt)
merge = Merge(Data1=simplify(graft(pt_2)), Data2=simplify(graft(dup)), Data3=simplify(graft(shift)))
dist = Distance(PointA=area.Centroid, PointB=attr_point)
vec2pt = Vector2Pt(PointA=pt, PointB=area.Centroid, Unitize=False)  # -> Vector, Length
eval = EvaluateCurve(Curve=ln, Parameter=chamfer_2)  # -> Point, Tangent, Angle
ln_2 = Line(StartPoint=pt_2, EndPoint=shift)
division = Division(A=1, B=dist)
pline = PolyLine(Vertices=merge, Closed=True)
rec_2pt = Rectangle2Pt(Plane=PlaneXY(0, 0, 0), PointA=pt_2, PointB=eval.Point, Radius=0)  # -> Rectangle, Length
pframe = PerpFrame(Curve=ln_2, Parameter=0.5)
rad = Radians(Degrees=75)
multiplication = Multiplication(A=division, B=falloff)
fillet_3 = Fillet(Curve=pline, Parameter=Slider(0.55, range=0..1), Radius=fillet_2)  # -> Curve, Parameter
c_script_2 = CSharpScript(x=multiplication, y=rad)  # -> out, A; inputs x: Double, y: Double
# ---------- c_script_2: C# ----------
    if(x >= y)
      A = y;
    else A = x;
# ---------- end c_script_2 ----------
rdiff = RegionDifference(CurvesA=fillet_3.Curve, CurvesB=rec_2pt.Rectangle)
sort = SortList(Keys=c_script_2.A)  # -> Keys, ValuesA
boundary = BoundarySurfaces(Edges=rdiff)  # -> simplify(Surfaces)
item = ListItem(List=sort.Keys, Index=0, Wrap=True)
item_2 = ListItem(List=sort.Keys, Index=-1, Wrap=True)
gradient = Gradient(
    LowerLimit=item,
    UpperLimit=item_2,
    Parameter=c_script_2.A,
    stops=[0: RGB(0, 120, 215), 0.46: RGB(173, 255, 47), 0.72: RGB(255, 255, 0), 1: RGB(255, 140, 0)])
move = Move(Geometry=graft(pframe), Motion=vec2pt.Vector)  # -> simplify(Geometry), Transform
dup_2 = DuplicateData(Data=graft(c_script_2.A), Number=4, Order=True)  # -> simplify(Data)
move_2 = Move(Geometry=boundary, Motion=vec2pt.Vector)  # -> Geometry, Transform
flip = FlipMatrix(Data=move.Geometry)
flip_2 = FlipMatrix(Data=move_2.Geometry)
dup_3 = DuplicateData(Data=graft(gradient), Number=4, Order=True)  # -> simplify(Data)
rotate = Rotate(Geometry=flip_2, Angle=expr("-x", dup_2), Plane=flip)  # -> Geometry, Transform
context_print = ContextPrint(Colors=dup_3)
context_bake = ContextBake(Geometry=rotate.Geometry)
preview = CustomPreview(Geometry=rotate.Geometry, Material=dup_3)
