# Grasshopper definition beam_mod.gh (Grasshopper 1.0.7)
# plug-ins: Kangaroo2 Components

# ---- group: Parameter
zwischenauflager = BooleanToggle(True)
länge = Slider(20, range=0..20)
position_zwischenauflager = Slider(0.99, range=0.01..0.99)

# ---- group: Inputs
length = GetNumber(länge, AtLeast=1, AtMost=1, Maximum=20, Minimum=0, TreeAccess=False)
position = GetNumber(position_zwischenauflager, AtLeast=1, AtMost=1, Maximum=0.99, Minimum=0.01, TreeAccess=False)
toggle = GetBoolean(zwischenauflager, AtLeast=1, AtMost=1, FalseValue="False", TreeAccess=False, TrueValue="True")

# ----
pt = ConstructPoint(XCoordinate=length, YCoordinate=0, ZCoordinate=0)
pt_2 = ConstructPoint(XCoordinate=0, YCoordinate=0, ZCoordinate=0)
ln = Line(StartPoint=pt_2, EndPoint=pt)
shatter = Shatter(Curve=reparameterize(ln), Parameters=position)
end = EndPoints(Curve=shatter)  # -> Start, End
item = ListItem(List=end.End, Index=0, Wrap=True)  # -> Item, Item1
filter = StreamFilter(Gate=toggle, Stream0=ln, Stream1=shatter)
item_2 = ListItem(List=end.Start, Index=0, Wrap=True)  # -> Item, Item1

# ----
# Auflager zeichnen
merge = Merge(Data1=item_2.Item, Data2=item_2.Item1, Data3=item.Item1)
end_2 = EndPoints(Curve=filter)  # -> Start, End
pt_3 = Point(merge)
pt_4 = Point([end_2.Start, end_2.End])
filter_2 = StreamFilter(Gate=toggle, Stream0=pt_4, Stream1=pt_3)  # -> graft(Stream)
vec = VectorXYZ(XComponent="0.3", YComponent=0, ZComponent="-0.4")  # -> Vector, Length
vec_2 = VectorXYZ(XComponent="-0.3", YComponent=0, ZComponent="-0.4")  # -> Vector, Length
move = Move(Geometry=filter_2, Motion=vec.Vector)  # -> Geometry, Transform
move_2 = Move(Geometry=filter_2, Motion=vec_2.Vector)  # -> Geometry, Transform

merge_2 = Merge(Data1=filter_2, Data2=move.Geometry, Data3=move_2.Geometry)
triangle = MeshTriangle(CornerA=0, CornerB=1, CornerC=2)
join = JoinCurves(Curves=shatter, Preserve=False)
conmesh = ConstructMesh(Vertices=merge_2, Faces=triangle)  # -> flatten(Mesh)
mp = MultiPipe(Curves=join, NodeSize="0.01", EndOffset=1, StrutSize=1, Segment=0, KinkAngle=0.6, CubeFit=0, Caps=0)
mjoin = MeshJoin(Meshes=conmesh)
context_bake = ContextBake(Geometry=mp)
outputs = ContextBake(Geometry=mjoin)
