# Grasshopper definition bench.gh (Grasshopper 1.0.7)

thickness = Slider(1.276, range=0.5..3)
rib_spacing = Slider(1.929, range=1..3)
length = Slider(80, range=48..120)
lift_height = Slider(15, range=0..24)
base_width = Slider(10, range=0..24)
pinch_width = Slider(4, range=0..24)
height = Slider(18, range=0..24)
top_width = Slider(24, range=0..24)
end_extrusion = Slider(12, range=0..24)
fillet = Slider(1, range=0..4)
flatten = BooleanToggle(True)
length_2 = GetNumber(length, AtLeast=1, AtMost=1, Maximum=1.797693135e+308, Minimum=-1.797693135e+308, TreeAccess=False)
spacing = GetNumber(rib_spacing, AtLeast=1, AtMost=1, Maximum=1.797693135e+308, Minimum=-1.797693135e+308, TreeAccess=False)
thickness_2 = GetNumber(thickness, AtLeast=1, AtMost=1, Maximum=1.797693135e+308, Minimum=-1.797693135e+308, TreeAccess=False)
flatten_2 = GetBoolean(flatten, AtLeast=1, AtMost=1, FalseValue="False", TreeAccess=False, TrueValue="True")
height_2 = GetNumber(lift_height, AtLeast=1, AtMost=1, Maximum=1.797693135e+308, Minimum=-1.797693135e+308, TreeAccess=False)
addition = Addition(A=height_2, B=2.5)
max = Maximum(A=height, B=addition)
pt = ConstructPoint(XCoordinate=expr("x/2", length_2), YCoordinate=0, ZCoordinate=height_2)
dup = DuplicateData(Data=base_width, Number=1, Order=True)  # -> flatten(Data)
pt_2 = ConstructPoint(XCoordinate=0, YCoordinate=expr("-x", end_extrusion), ZCoordinate=0)
pt_3 = ConstructPoint(XCoordinate=0, YCoordinate=0, ZCoordinate=0)
pt_4 = ConstructPoint(XCoordinate=length_2, YCoordinate=0, ZCoordinate=0)
pt_5 = ConstructPoint(XCoordinate=0, YCoordinate=0, ZCoordinate=max)
pt_6 = ConstructPoint(XCoordinate=length_2, YCoordinate=0, ZCoordinate=max)
subtraction = Subtraction(A=spacing, B=0.5)
min = Minimum(A=subtraction, B=thickness_2)
Y = UnitY(Factor=1)
Y_2 = UnitY(Factor=1)
intcrv = Interpolate(Vertices=[pt_3, pt, pt_4], Degree=3, Periodic=False, KnotStyle=1)  # -> Curve, Length, Domain
Y_3 = UnitY(Factor=expr("-x/2", top_width))
Y_4 = UnitY(Factor=expr("-x/2", [base_width, pinch_width, dup]))
line = LineSDL(Start=[pt_5, pt_6], Direction=Y, Length=top_width)
line_2 = LineSDL(Start=[pt_3, pt, pt_4], Direction=Y_2, Length=[base_width, pinch_width, dup])
move = Move(Geometry=line, Motion=Y_3)  # -> Geometry, Transform
move_2 = Move(Geometry=line_2, Motion=Y_4)  # -> Geometry, Transform
swp1 = Sweep1(Rail=intcrv.Curve, Sections=move_2.Geometry, Miter=1)
loft = Loft(Curves=move.Geometry, Options={Adjust=False, Closed=False, LoftEnds=0, LoftSimp=0, LoftType=0, Rebuild=10, Refit=0.01})
edges = BrepEdges(Brep=loft)  # -> Naked, Interior, NonManifold
edges_2 = BrepEdges(Brep=swp1)  # -> Naked, Interior, NonManifold
item = ListItem(List=edges.Naked, Index=0, Wrap=True)
item_2 = ListItem(List=edges_2.Naked, Index=0, Wrap=True)
loft_2 = Loft(
    Curves=flatten([item_2, item]),
    Options={Adjust=False, Closed=False, LoftEnds=0, LoftSimp=0, LoftType=0, Rebuild=10, Refit=0.01})
xz = XZPlane(Origin=Point(0, 0, 0))
mirror = Mirror(Geometry=loft_2, Plane=xz)  # -> Geometry, Transform
join = BrepJoin(Breps=flatten([swp1, loft_2, loft, mirror.Geometry]))  # -> Breps, Closed
edges_3 = BrepEdges(Brep=join.Breps)  # -> Naked, Interior, NonManifold
multiplication = Multiplication(A=end_extrusion, B=-1)
pt_7 = ConstructPoint(XCoordinate=expr("-x", end_extrusion), YCoordinate=expr("-x", end_extrusion), ZCoordinate=0)
join_2 = JoinCurves(Curves=edges_3.Naked, Preserve=False)
X = UnitX(Factor=[multiplication, end_extrusion])
extr = Extrude(Base=join_2, Direction=X)
X_2 = UnitX(Factor=1)
join_3 = BrepJoin(Breps=flatten([join.Breps, extr]))  # -> Breps, Closed
X_3 = UnitX(Factor=1)
X_4 = UnitX(Factor=min)
multiplication_2 = Multiplication(A=end_extrusion, B=2)
addition_2 = Addition(A=max, B=6)
addition_3 = Addition(A=top_width, B=6)
addition_4 = Addition(A=length_2, B=multiplication_2)
line_3 = LineSDL(Start=pt_7, Direction=X_2, Length=addition_4)
divdist = DivideDistance(Curve=line_3, Distance=spacing)  # -> Points, Tangents, Parameters
yz = YZPlane(Origin=divdist.Points)
sec = BrepPlane(Brep=join_3.Breps, Plane=yz)  # -> Curves, Points
fit = FitCurve(Curve=sec.Curves)
fillet_2 = Fillet(Curve=fit, Radius=fillet)
lng = ListLength(List=flatten(fillet_2))
division = Division(A=addition_4, B=addition_3)
extr_2 = Extrude(Base=fillet_2, Direction=X_4)
round = Round(Number=division)  # -> Nearest, Floor, Ceiling
cap = CapHoles(Brep=extr_2)
X_5 = UnitX(Factor=end_extrusion)
division_2 = Division(A=lng, B=round.Floor)
move_3 = Move(Geometry=cap, Motion=X_5)  # -> flatten(Geometry), Transform
round_2 = Round(Number=division_2)  # -> Nearest, Floor, Ceiling
pt_8 = ConstructPoint(XCoordinate=0, YCoordinate=addition_2, ZCoordinate=0)
edges_4 = BrepEdges(Brep=move_3.Geometry)  # -> Naked, flatten(Interior), NonManifold
series = Series(Start=0, Step=round_2.Ceiling, Count=round.Floor)
context_bake = ContextBake(Geometry=move_3.Geometry)
recgrid = Rectangular(Plane=pt_8, SizeX=addition_3, SizeY=addition_2, ExtentX=round.Floor, ExtentY=round_2.Ceiling)  # -> Cells, Points
context_bake_2 = ContextBake(Geometry=edges_4.Interior)
series_2 = Series(Start=series, Step=1, Count=round_2.Ceiling)
flip = FlipMatrix(Data=recgrid.Cells)
item_3 = ListItem(List=flatten(fillet_2), Index=series_2, Wrap=True)
explode = Explode(Curve=recgrid.Cells, Recursive=True)  # -> Segments, Vertices
pcen = PolygonCenter(Polyline=flip)  # -> CenterV, CenterE, CenterA
flip_2 = FlipMatrix(Data=item_3)
area = Area(Geometry=flip_2)  # -> Area, Centroid
yz_2 = YZPlane(Origin=area.Centroid)
orient = Orient(Geometry=flip_2, Source=yz_2, Target=pcen.CenterV)  # -> Geometry, Transform
explode_2 = Explode(Curve=orient.Geometry, Recursive=True)  # -> Segments, Vertices
end = EndPoints(Curve=explode_2.Segments)  # -> Start, End
pdecon = Deconstruct(Point=end.Start)  # -> XComponent, YComponent, ZComponent
pdecon_2 = Deconstruct(Point=end.End)  # -> XComponent, YComponent, ZComponent
addition_5 = Addition(A=pdecon.YComponent, B=pdecon_2.YComponent)
sort = SortList(Keys=addition_5, ValuesA=explode_2.Segments)  # -> reverse(Keys), reverse(ValuesA)
item_4 = ListItem(List=sort.ValuesA, Index=0, Wrap=True)
len = Length(Curve=item_4)  # -> flatten(Length)
sort_2 = SortList(Keys=len)  # -> Keys, ValuesA
number_slider = Slider(1, range=0..2)
item_5 = ListItem(List=sort_2.Keys, Index=0, Wrap=True)
division_3 = Division(A=item_5, B=3)
vec = VectorXYZ(XComponent=division_3, YComponent=expr("-x", number_slider), ZComponent=0)  # -> Vector, Length
vec_2 = VectorXYZ(XComponent=expr("-x", division_3), YComponent=expr("-x", number_slider), ZComponent=0)  # -> Vector, Length
midpt = CurveMiddle(Curve=item_4)
move_4 = Move(Geometry=midpt, Motion=[vec.Vector, vec_2.Vector])  # -> Geometry, Transform
Z = UnitZ(Factor=-0.01)
cir = Circle(Plane=move_4.Geometry, Radius=Slider(0.5, range=0..1))
boundary = BoundarySurfaces(Edges=flatten([orient.Geometry, cir]))
extr_3 = Extrude(Base=boundary, Direction=Z)
dispatch = Dispatch(List=flatten([explode.Segments, orient.Geometry, cir]), DispatchPattern=flatten_2)  # -> ListA, ListB
dispatch_2 = Dispatch(List=flatten(extr_3), DispatchPattern=flatten_2)  # -> ListA, ListB
crv = Curve(dispatch.ListA)
clean = CleanTree(RemoveNulls=True, RemoveInvalid=True, RemoveEmpty=True, Tree=crv)  # -> flatten(Tree)
clean_2 = CleanTree(RemoveNulls=True, RemoveInvalid=True, RemoveEmpty=True, Tree=dispatch_2.ListA)  # -> flatten(Tree)
geo = Geometry(clean)
geo_2 = Geometry(clean_2)
context_bake_3 = ContextBake(Geometry=geo)
context_bake_4 = ContextBake(Geometry=geo_2)
