# Grasshopper definition brep_union.gh (Grasshopper 1.0.7)

brep = Brep([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])
breps = GetGeometry(brep, AnnotationTypeFilter=0, AtLeast=1, AtMost=2147483647, DeleteInput=False, Filter=1073741840, TreeAccess=False)
sunion = SolidUnion(Breps=breps)
context_bake = ContextBake(Content=sunion)
