# Grasshopper definition rnd_lattice.gh (Grasshopper 1.0.7)
# plug-ins: Kangaroo2 Components

# ---- group: RH_IN:nodeSize
number_slider = Slider(7, range=3..10)

# ---- group: RH_IN:boxSize
number_slider_2 = Slider(10, range=0.5..10)

# ---- group: RH_IN:count
number_slider_3 = Slider(42, range=10..100)

# ----
box = CenterBox(Base=PlaneXY(0, 0, 0), X=number_slider_2, Y=number_slider_2, Z=number_slider_2)
division = Division(A=number_slider, B="10")
pop3d = Populate3D(Region=box, Count=number_slider_3, Seed=1)
prox = Proximity3D(Points=pop3d, Group=5)  # -> flatten(Links), Topology
dupln = RemoveDuplicateLines(Lines=prox.Links, Tolerance=0.01)
mp = MultiPipe(Curves=dupln, NodeSize=division, EndOffset=1, StrutSize=1, Segment=0, KinkAngle=0.6, CubeFit=0)
meshsubd = MeshFromSubD(SubD=mp, Density=2)
weld = WeldMesh(Mesh=meshsubd, Angle=3.141592654)

# ---- group: Cheap Occlusion
demesh = DeconstructMesh(Mesh=weld)  # -> Vertices, Faces, Colours, Normals
amp = Amplitude(Vector=demesh.Normals, Amplitude="0.1")
addition = Addition(A=demesh.Vertices, B=amp)
meshray = MeshRay(Mesh=weld, Point=addition, Direction=amp)  # -> Point, Hit
gradient = Gradient(LowerLimit=0, UpperLimit=1, Parameter=meshray.Hit, stops=[0: RGB(235, 235, 235), 1: RGB(0, 0, 0)])
mcol = MeshColours(Mesh=weld, Colours=gradient)
mblur = BlurMesh(Mesh=mcol, Iterations=Slider(5, range=0..5))

# ----
mesh = Mesh(mblur)
M = MeshToBase64Draco(mesh=mesh)  # -> base64Draco; inputs mesh: Mesh
# ---------- M: C# ----------
    var options = new Rhino.FileIO.DracoCompressionOptions();
    options.CompressionLevel = 5;
    options.IncludeTextureCoordinates = false;
    options.IncludeVertexColors = false;

    var compressed = Rhino.FileIO.DracoCompression.Compress(mesh, options);
    base64Draco = compressed.ToBase64String();
# ---------- end M ----------

# ---- group: RH_OUT:meshb64
txt = Text(M)
